# Grasshopper definition vizualize_pnts.ghx (Grasshopper 1.0.7)

# ----
# 170,469 is the total number of points
# for R1 work volume at 0.1m spacing
# x: -3.2 --> 6.0
# y: 0.3 --> 4.9
# z: -0.4 --> 3.4
# 
# 170,469 is the total number of points
# for R2 work volume at 0.1m spacing
# x: -3.2 --> 6.0
# y: -1.5 --> 3.1
# z: -0.4 --> 3.4
# 
# 162,240 is the total number of points
# for R3 work volume at 0.1m spacing
# x: 1.7 --> 8.0
# y: -1.5 --> 4.9
# z: -0.4 --> 3.4
# 
# 286,455 is the total number of points
# for 3 robot work volume at 0.1m spacing
# x: -3.2 --> 8.0
# y: -1.5 --> 4.9
# z: -0.4 --> 3.4
panel = Panel("/Users/edvard/Documents/github/rob_fab_reach/_data_track")
cumulative_steps = Slider(100, range=1..100)
list = ValueList({"Robot 1": "rob1", "Robot 2": "rob2", "Robot 3": "rob3", "Robot 1&2": "rob1,rob2", "Robot 1&3": "rob1,rob3", "Robot 2&3": "rob2,rob3", "Robot 1&2&3": "rob1,rob2,rob3"}, selected="Robot 1")

pt = Point(Point(4.047665691, 1.724886209, -0.3))

angle = Slider(20, range=0..45)
width = Slider(10, range=0..10)
aspect_ratio = Slider(0.6, range=0.1..2)
pt_2 = Point(Point(4.047665691, 1.724886209, -0.3))

pdecon = Deconstruct(Point=pt_2)  # -> XComponent, YComponent, ZComponent
pt_3 = ConstructPoint(XCoordinate=pdecon.XComponent, YCoordinate=pdecon.YComponent, ZCoordinate="-0.3")
movetoplane = MoveToPlane(Geometry=pt_2, Plane=PlaneXY(0, 0, 0), Above=True, Below=True)  # -> Geometry, Transform
# single direction reachability
number_slider = Slider(50, range=1..100)

# ----
# 'n' robots reach
# (0 and 1, equivalent to No/Yes)
# (2 and 3, if you are reading in data for 2 or 3 robs)
number_slider_2 = Slider(3, range=0..3)
data = Data(panel)
data_2 = Data("{}/{}_vec{:0>3}.json")
data_3 = Data(list)
data_4 = Data(number_slider)
python = GhPythonScript(path=data, name=data_2, rob_num=data_3, step_num=data_4, read_data=Toggle(False))  # -> points, values, vector; inputs step_num: Int32
# ---------- python: Python ----------
import os
import json
from compas_fab.utilities import read_data_from_json
from compas_fab.robots import Configuration


def initialize_count(rob_num):
    
    point_count = {}
    
    for rob in rob_num:
        print rob
        filename = name.format(rob,rob,1) # just take first to init
        filepath = os.path.join(path, filename)
        
        print filepath
        
        with open(filepath, "r") as f:
            file_data = f.read()
            
        f.close()
        
        data = json.loads(file_data)
        point_count.update(data['results'])
        
        print len(point_count)
        
    for key in point_count:
        point_count[key] = 0
    
    return point_count


if read_data:
    
    rob_num = rob_num.split(",")
    point_count = initialize_count(rob_num)
    
    for rob in rob_num:
        print "read", rob
        filename = name.format(rob,rob,step_num)
        filepath = os.path.join(path, filename)
    
        with open(filepath, "r") as f:
            file_data = f.read()
            data = json.loads(file_data)
            f.close()
        
        for pnt,result in data['results'].items():
            if result:
                point_count[pnt] += 1
                    
    vector = data['vector']
    points = point_count.keys()
    values = point_count.values()
# ---------- end python ----------

# ----
# cumulative reachability - total
toggle = BooleanToggle(False)
data_5 = Data(panel)
data_6 = Data("{}/_{}_TOTAL.json")
data_7 = Data(list)
python_2 = GhPythonScript(path=data_5, name=data_6, rob_num=data_7, read_data=toggle)  # -> points, values, coop_points, simplify(vectors)
# ---------- python_2: Python ----------
import os
import json
from compas_fab.utilities import read_data_from_json
from compas_fab.robots import Configuration

from copy import deepcopy

import ghpythonlib.treehelpers as th

"""


243,360 is the total number of points
for 3 robot work volume at 0.1m spacing
x: -1.5 --> 8.0
y: -1.5 --> 4.9
z: -0.4 --> 3.4
"""

def count_data(rob_num):
    count_total = {}
    count_cooperative = {}
    
    #read in data based on how many robots
    filepaths = [os.path.join(path, name.format(rob,rob)) for rob in rob_num]
    files = [open(filepath, "r") for filepath in filepaths]
    datas = [json.loads(file.read()) for file in files]
    
    for f in files:
        f.close()
    
    #initialize the dictionary, each unique point
    for data in datas:
        count_total.update(data['results'])
    
    #zero all the values in the dictionary
    for key in count_total:
        count_total[key] = 0
        
    count_cooperative = count_total.copy()
    
    #read in all data, sum in total count, sum in # robs reached
    for data in datas:
        for key,value in data['results'].items():
            
            if value:
                count_total[key] += value
                count_cooperative[key] += 1


    return count_total, count_cooperative



if read_data:
    rob_num = rob_num.split(",")
    
    count_total,count_cooperative = count_data(rob_num)
    
    #else: only show points where all robots can reach
    #if comment out the else, then show points where at least 1 can reach
    for key,value in count_cooperative.items():
        if value == len(rob_num):
            count_cooperative[key] = 1
#        else:
#            count_cooperative[key] = 0
    
    points = count_total.keys()
    values = count_total.values()
    coop_points = count_cooperative.values()
    
    #    vectors = th.list_to_tree(vectors, source=[0,0])
# ---------- end python_2 ----------

# ----
# cumulative reachability - one by one
toggle_2 = BooleanToggle(False)
data_8 = Data(panel)
data_9 = Data("{}/{}_vec{:0>3}.json")
data_10 = Data(list)
data_11 = Data(cumulative_steps)
python_3 = GhPythonScript(path=data_8, name=data_9, rob_num=data_10, step_num=data_11, read_data=toggle_2)  # -> points, values, coop_points, simplify(vectors); inputs step_num: Int32
# ---------- python_3: Python ----------
import os
import json
from compas_fab.utilities import read_data_from_json
from compas_fab.robots import Configuration

import ghpythonlib.treehelpers as th

"""
243,360 is the total number of points
for 3 robot work volume at 0.1m spacing
x: -1.5 --> 8.0
y: -1.5 --> 4.9
z: -0.4 --> 3.4
"""

def initialize_count(rob_num):
    """return a dictionary full of 0s"""
    
    point_count = {}
    
    for rob in rob_num:
        filename = name.format(rob,rob,1) # just take first to init
        filepath = os.path.join(path, filename)
        
        with open(filepath, "r") as f:
            file_data = f.read()
            
        f.close()
        
        data = json.loads(file_data)
        point_count.update(data['results'])
        
        print len(point_count)
        
    for key in point_count:
        point_count[key] = 0
    
    return point_count

    

if read_data:
    
    rob_num = rob_num.split(",")
    
    point_count = initialize_count(rob_num)
    cooperative_count_save = point_count.copy()
    cooperative_count_zero = point_count.copy()
    vectors = []
    
        
    for i in range(1,step_num+1):
        
        # re-zero it
        cooperative_count = cooperative_count_zero.copy()

        for rob in rob_num:
            print "{}: vector {}".format(rob,i)
            
            filename = name.format(rob,rob,i)
            filepath = os.path.join(path, filename)
            
            with open(filepath, "r") as f:
                file_data = f.read()
                data = json.loads(file_data)
                f.close()
                
                vec = data['vector']
                vectors.append(vec)
            
            for pnt,result in data['results'].items():
                if result:
                    cooperative_count[pnt] += 1
                    point_count[pnt] += 1
                    
        #after all robs done
        #keep over-writing if already 1, then stays 1
        for pnt,result in cooperative_count.items():
            if result == len(rob_num):
                cooperative_count_save[pnt] = 1
            
    #output data
    vectors = th.list_to_tree(vectors, source=[0,0])
    points = point_count.keys()
    values = point_count.values()
    
    coop_points = cooperative_count_save.values()
# ---------- end python_3 ----------
num = Number(python_3.vectors)

# ----
# SINGLE ARCH
division = Division(A=graft(width), B=2)
rad = Radians(Degrees=graft(angle))
multiplication = Multiplication(A=division, B=graft(aspect_ratio))
X = UnitX(Factor=expr("-x", division))
Z = UnitZ(Factor=multiplication)
X_2 = UnitX(Factor=division)
move = Move(Geometry=pt_2, Motion=Z)  # -> Geometry, Transform
X_3 = UnitX(Factor=-1)
move_2 = Move(Geometry=pt_2, Motion=[X_2, X])  # -> Geometry, Transform
rot3d = Rotate3D(Geometry=move.Geometry, Angle=rad, Center=pt_2, Axis=X_3)  # -> Geometry, Transform
item = ListItem(List=move_2.Geometry, Index=0, Wrap=True)  # -> Item, Item1
merge = Merge(Data1=item.Item, Data2=rot3d.Geometry, Data3=item.Item1)

aspect_ratio_2 = Panel("""0.25
0.50
0.75
1.00
1.50""")
angles = Panel("""0
15
30
45""")
widths = Panel("""2
3
4
5
6
7""")
python_4 = GhPythonScript(p=pt_2, angles=angles, widths=widths, ratios=aspect_ratio_2)  # -> simplify(points_out), simplify(variables_out); inputs p: Point3d, angles: list, widths: list, ratios: list
# ---------- python_4: Python ----------
__author__ = "Edvard"
__version__ = "2023.06.12"

import rhinoscriptsyntax as rs
import ghpythonlib.treehelpers as th
from Rhino.Geometry import Vector3d

import math
from copy import deepcopy

width_sublist = [[] for i in range(len(widths))]
point_sets = [deepcopy(width_sublist) for i in range(len(angles))]
data_sets = deepcopy(point_sets)

print point_sets


for i,angle in enumerate(angles):
    for j,width in enumerate(widths):
        for ratio in ratios:
            v1 = Vector3d(0,0,0)
            v2 = Vector3d(-width,0,0)
            
            #make end points
            p_start= rs.CopyObject(p,v1)
            p_end = rs.CopyObject(p,v2)
            
            height = (width/2)*ratio
            
            v3 = Vector3d(-width/2,0,height)
            p_mid = rs.CopyObject(p,v3)
            
            p_mid_new = rs.RotateObject(p_mid,p,angle,axis=Vector3d(-1,0,0),copy=True)
            
            point_set = [p_start, p_mid_new, p_end]
            point_sets[i][j].append(point_set)
            data_sets[i][j].append([angle,width,ratio])
            
            

#print point_sets
print data_sets
points_out = th.list_to_tree(point_sets)
variables_out = th.list_to_tree(data_sets)
# ---------- end python_4 ----------

# ----
# if TRUE then show all for variable
number_slider_3 = Slider(3, range=0..10)
ratio_idx = Slider(3, range=0..10)
python_5 = GhPythonScript(
    angle_idx=Slider(0, range=0..10),
    angle_filter=Toggle(False),
    width_idx=number_slider_3,
    width_filter=Toggle(False),
    ratio_idx=ratio_idx,
    ratio_filter=Toggle(False))  # -> out, path; inputs angle_idx: Int32, width_idx: Int32, ratio_idx: Int32
# ---------- python_5: Python ----------
__author__ = "Edvard"
__version__ = "2023.06.12"

import rhinoscriptsyntax as rs

if angle_filter:
    i = "?"
else:
    i = angle_idx
    

if width_filter:
    j = "?"
else:
    j = width_idx
    
    
if ratio_filter:
    k = "?"
else:
    k = ratio_idx
    

path = "{{{};{};{}}}".format(i,j,k)

print path
# ---------- end python_5 ----------

int = Integer(number_slider_2)
mindex = MemberIndex(Set=python.values, Member=int)  # -> Index, Count
dispatch = Dispatch(List=python.points, DispatchPattern=python.values)  # -> ListA, ListB
item_2 = ListItem(List=python.points, Index=mindex.Index, Wrap=True)

list_2 = ValueList({"From One-by-One": 0, "From Total": 1}, selected="From Total")
filter = StreamFilter(Gate=list_2, Stream0=python_3.points, Stream1=python_2.points)
filter_2 = StreamFilter(Gate=list_2, Stream0=python_3.values, Stream1=python_2.values)
filter_3 = StreamFilter(Gate=list_2, Stream0=python_3.coop_points, Stream1=python_2.coop_points)
pt_4 = Point(filter)
int_2 = Integer(filter_2)
int_3 = Integer(filter_3)

int_4 = Integer(int_2)
data_12 = Data(cumulative_steps)
data_13 = Data(list)
values = GhPythonScript(rob_num=data_13, values=int_4, n_steps=data_12)  # -> max_index, max_counts, counts; inputs values: list, n_steps: Int32
# ---------- values: Python ----------
counts = []

rob_num = rob_num.split(",")

# maximum number of possible reaches per point
max = n_steps * len(rob_num)

# count how many times a number of reaches occurs
for i in range(0,max + 1):
    counts.append(values.count(i))

# what is the maximum number of reaches in whole volume
for i,cnt in enumerate(counts):
    if cnt:
        max_index = i

# for many points does maximum number of reaches occur
max_counts = counts[max_index]
# ---------- end values ----------
panel_2 = Panel(values.counts)
panel_3 = Panel(values.max_index)
panel_4 = Panel(values.max_counts)
rec = DataRecorder(panel_4, DataLimit=-10, RecordData=False)
panel_5 = Panel(rec)

# ----
# 3D GRID OF ARCHES
panel_6 = Panel(python_5.path)
pt_5 = Point(python_4.points_out)
viewer = ParamViewer(python_4.points_out)
split = SplitTree(Data=python_4.variables_out, Masks=flatten(python_5.path))  # -> Positive, Negative
split_2 = SplitTree(Data=python_4.points_out, Masks=flatten(python_5.path))  # -> Positive, Negative
viewer_2 = ParamViewer(split_2.Positive)

# ----
# View Reach Vector
item_3 = ListItem(List=python.vector, Index=0, Wrap=True)  # -> Item, Item1, Item2
panel_7 = Panel(python.vector)
pt_6 = ConstructPoint(XCoordinate=0, YCoordinate=-5, ZCoordinate=0)
vec = VectorXYZ(XComponent=item_3.Item, YComponent=item_3.Item1, ZComponent=item_3.Item2)  # -> Vector, Length
vdisex = VectorDisplayEx(Point=pt_6, Vector=vec.Vector, Colour=ColourSwatch(SwatchColor=RGB(252, 167, 167)), Width="8")

# ----
# YES reach
lng = ListLength(List=dispatch.ListA)
panel_8 = Panel(lng)
preview = CustomPreview(Geometry=dispatch.ListA, Material=ColourSwatch(SwatchColor=RGB(0, 34, 255)))

# ----
# NO reach
lng_2 = ListLength(List=dispatch.ListB)
panel_9 = Panel(lng_2)
preview_2 = CustomPreview(Geometry=dispatch.ListB, Material=ColourSwatch(SwatchColor=RGB(0, 0, 0)))

# ----
# 'n' robot reach
lng_3 = ListLength(List=item_2)
panel_10 = Panel(lng_3)
preview_3 = CustomPreview(Geometry=item_2, Material=ColourSwatch(SwatchColor=RGB(250, 12, 12)))

# ----
# draw brick volumes tangent to the curve. unique number of bricks per leg of arch.
pt_7 = Point(split_2.Positive)
intcrv = Interpolate(Vertices=pt_7, Degree=3, Periodic=False, KnotStyle=1)  # -> Curve, Length, Domain
len = Length(Curve=flatten(intcrv.Curve))
division_2 = Division(A="0.075", B=2)
division_3 = Division(A="0.225", B=2)
division_4 = Division(A="0.1125", B=2)
division_5 = Division(A=len, B="0.075")
crv = Curve(intcrv.Curve)
int_5 = Integer(graft(division_5))
divide = DivideCurve(Curve=crv, Count=int_5, Kinks=False)  # -> Points, Tangents, Parameters
pframe = PerpFrame(Curve=crv, Parameter=divide.Parameters)  # -> simplify(Frame)
box = CenterBox(Base=pframe, X=division_3, Y=division_4, Z=division_2)

# ----
# See all points
panel_11 = Panel(panel_3)
gradient = Gradient(
    LowerLimit="0",
    UpperLimit=panel_11,
    Parameter=int_2,
    stops=[0: RGB(255, 255, 255), 0.1: RGB(236, 27, 60), 0.2: RGB(210, 0, 118), 0.3: RGB(103, 0, 120), 0.4: RGB(39, 72, 161), 0.5: RGB(1, 192, 229), 0.6: RGB(18, 178, 90), 0.7: RGB(79, 186, 8), 0.8: RGB(220, 237, 32), 0.9: RGB(247, 159, 20), 1: RGB(243, 57, 0)])
gradient_2 = Gradient(
    LowerLimit="0",
    UpperLimit=panel_11,
    Parameter=int_2,
    stops=[0: RGB(255, 255, 255), 0.8: RGB(255, 0, 0), 0.986: RGB(145, 0, 0), 1: RGB(0, 0, 0)])
preview_4 = CustomPreview(Geometry=pt_4, Material=gradient)  # disabled

# ----
# See points with a specified number of reaches
panel_12 = Panel("0")
int_6 = Integer(panel_12)
mindex_2 = MemberIndex(Set=int_2, Member=int_6)  # -> Index, Count
item_4 = ListItem(List=pt_4, Index=mindex_2.Index, Wrap=True)
preview_5 = CustomPreview(Geometry=item_4, Material=ColourSwatch(SwatchColor=RGB(0, 34, 255)))  # disabled

# ----
# See points with a specified % of maximum reaches
panel_13 = Panel(panel_3)
multiplication_2 = Multiplication(A=panel_13, B=Slider(1, range=0..1))
larger = LargerThan(FirstNumber=int_2, SecondNumber=multiplication_2)  # -> LargerThan, OrEqualTo
dispatch_2 = Dispatch(List=pt_4, DispatchPattern=larger.OrEqualTo)  # -> ListA, ListB
preview_6 = CustomPreview(Geometry=dispatch_2.ListA, Material=ColourSwatch(SwatchColor=RGB(217, 80, 80)))  # disabled

# ----
# See points with 100% of maximum reaches
panel_14 = Panel(panel_3)
int_7 = Integer(panel_14)
mindex_3 = MemberIndex(Set=int_2, Member=int_7)  # -> Index, Count
item_5 = ListItem(List=pt_4, Index=mindex_3.Index, Wrap=True)
preview_7 = CustomPreview(Geometry=item_5, Material=ColourSwatch(SwatchColor=RGB(0, 0, 0)))  # disabled

flip = FlipMatrix(Data=num)
branch = TreeBranch(Tree=flip, Path="{1}", MaintainPaths=True)
branch_2 = TreeBranch(Tree=flip, Path="{2}", MaintainPaths=True)
branch_3 = TreeBranch(Tree=flip, Path="{0}", MaintainPaths=True)
pt_8 = ConstructPoint(XCoordinate=6, YCoordinate=-3, ZCoordinate=0)
vec_2 = VectorXYZ(XComponent=branch_3, YComponent=branch, ZComponent=branch_2)  # -> Vector, Length
vdisex_2 = VectorDisplayEx(Point=pt_8, Vector=vec_2.Vector, Colour=RGB(0, 0, 0), Width="1")

# ----
# See points where there is cooperative reach (multi robots can reach)
dispatch_3 = Dispatch(List=pt_4, DispatchPattern=int_3)  # -> ListA, ListB
dispatch_4 = Dispatch(List=int_2, DispatchPattern=int_3)  # -> ListA, ListB
panel_15 = Panel(panel_3)
gradient_3 = Gradient(
    LowerLimit="0",
    UpperLimit=panel_15,
    Parameter=dispatch_4.ListA,
    stops=[0: RGB(255, 255, 255), 0.1: RGB(236, 27, 60), 0.2: RGB(210, 0, 118), 0.3: RGB(103, 0, 120), 0.4: RGB(39, 72, 161), 0.5: RGB(1, 192, 229), 0.6: RGB(18, 178, 90), 0.7: RGB(79, 186, 8), 0.8: RGB(220, 237, 32), 0.9: RGB(247, 159, 20), 1: RGB(243, 57, 0)])
pt_9 = Point(dispatch_3.ListA)
preview_8 = CustomPreview(Geometry=pt_9, Material=gradient_3)

# ----
# R1
panel_16 = Panel("{6.0,0.3,3.4}")
# visualize volumes
# search domain, diagonal corners
panel_17 = Panel("{-1.5,4.9,-0.4}")
pt_10 = Point(panel_17)
pt_11 = Point(panel_16)
box_2 = Box2Pt(PointA=pt_10, PointB=pt_11, Plane=PlaneXY(0, 0, 0))
preview_9 = CustomPreview(Geometry=box_2, Material=ColourSwatch(SwatchColor=RGBA(255, 0, 0, 64)))

panel_18 = Panel("collision mesh (ground)")
pt_12 = Point("{-3,-3,-0.4}")
pt_13 = Point("{7,6,-0.375}")
box_3 = Box2Pt(PointA=pt_12, PointB=pt_13, Plane=PlaneXY(0, 0, 0))

# ----
# R2
panel_19 = Panel("{-1.5,-1.5,-0.4}")
pt_14 = Point("{6.0,3.1,3.4}")
pt_15 = Point(panel_19)
box_4 = Box2Pt(PointA=pt_15, PointB=pt_14, Plane=PlaneXY(0, 0, 0))
preview_10 = CustomPreview(Geometry=box_4, Material=ColourSwatch(SwatchColor=RGBA(0, 34, 255, 64)))

# ----
# R3
panel_20 = Panel("{1.7,-1.5,-0.4}")
pt_16 = Point(panel_20)
pt_17 = Point("{8.0,4.9,3.4}")
box_5 = Box2Pt(PointA=pt_16, PointB=pt_17, Plane=PlaneXY(0, 0, 0))
preview_11 = CustomPreview(Geometry=box_5, Material=ColourSwatch(SwatchColor=RGBA(255, 255, 0, 64)))

sint = SolidIntersection(BrepsA=box_4, BrepsB=box_2)
sdiff = SolidDifference(BrepsA=box_4, BrepsB=box_2)
sdiff_2 = SolidDifference(BrepsA=box_2, BrepsB=box_4)
sint_2 = SolidIntersection(BrepsA=sint, BrepsB=box_5)
sdiff_3 = SolidDifference(BrepsA=sint, BrepsB=box_5)
preview_12 = CustomPreview(Geometry=sint_2, Material=ColourSwatch(SwatchColor=RGBA(255, 0, 0, 64)))
preview_13 = CustomPreview(Geometry=sdiff_3, Material=ColourSwatch(SwatchColor=RGBA(255, 255, 0, 64)))
preview_14 = CustomPreview(Geometry=[sdiff, sdiff_2], Material=ColourSwatch(SwatchColor=RGBA(0, 34, 255, 64)))

deplane = DeconstructPlane(Plane=pframe)  # -> Origin, XAxis, YAxis, ZAxis
pdecon_2 = Deconstruct(Point=deplane.Origin)  # -> XComponent, YComponent, ZComponent
expression = Expression(x=pdecon_2.XComponent, Expression="round(x,1)")
expression_2 = Expression(x=pdecon_2.YComponent, Expression="round(x,1)")
expression_3 = Expression(x=pdecon_2.ZComponent, Expression="round(x,1)")
pt_18 = ConstructPoint(XCoordinate=expression, YCoordinate=expression_2, ZCoordinate=expression_3)

panel_21 = Panel("/Users/edvard/Documents/github/rob_fab_reach/_data/results_planar_arches")
data_14 = Data(dispatch_3.ListA)
data_15 = Data(dispatch_4.ListA)
data_16 = Data(panel_21)
python_6 = GhPythonScript(points=data_14, values=data_15, path=data_16, arch_points=pt_18, arch_variables=split.Positive, save_data=Toggle(False))  # -> out, output; inputs points: list of Point3d, values: list, arch_points: tree of Point3d, arch_variables: tree
# ---------- python_6: Python ----------
__author__ = "Edvard"
__version__ = "2023.06.13"

import rhinoscriptsyntax as rs
import ghpythonlib.treehelpers as th

import os
import json

from collections import OrderedDict


def save_json(v,data):
    name = "a{:0>2}_w{:0>2}_r{:0>3}"
    
    angle = str(v["angle"]).split('.')[0]
    width = str(v["width"]).replace('.','')
    ratio = str(int(round(v["ratio"]*100,0))).replace('.','')
    
    print ratio
    
    filename = name.format(angle,width,ratio) # just take first to init
    filepath = os.path.join(path, filename)
    
    with open(filepath, "w") as f:
        json.dump(data,f,indent=4)
        f.close()

for i in range(arch_points.BranchCount):
    saved_data = OrderedDict()
    saved_variables = OrderedDict()
    
    branch_list = arch_points.Branch(i)
    
    n_total = len(branch_list)
    n_notreach = 0
    n_reach = 0
    value = 0

    for arch_point in branch_list:
        try:
            idx = points.index(arch_point)
            value += values[idx]
            
            n_reach += 1
        except:
            n_notreach += 1
    

    saved_data["bricks_total"] = n_total
    saved_data["bricks_reach"] = n_reach
    saved_data["bricks_notreach"] = n_notreach
    saved_data["reach_ratio"] = round(n_reach/n_total,2)
    saved_data["avg_reach_score"] = int(round(value/n_total,0))
    
    
    
    saved_variables["angle"] = arch_variables.Branch(i)[0]
    saved_variables["width"] = arch_variables.Branch(i)[1]
    saved_variables["ratio"] = arch_variables.Branch(i)[2]
    
    output = {
        "arch_info":saved_variables,
        "data":saved_data
        }
    
    print output
    
    if save_data:
        save_json(saved_variables, output)
# ---------- end python_6 ----------
panel_22 = Panel(python_6.out)
